# Grasshopper definition BranchNodeRnd.gh (Grasshopper 1.0.7)
# plug-ins: LunchBox, Weaverbird

number_slider = Slider(5, range=0..10)
number_slider_2 = Slider(1, range=0..1)

# ---- group: RH_IN:201:Length
branch_length = Slider(10, range=0..10)

# ---- group: RH_IN:201:Radius
cell_radius = Slider(10, range=0..10)

# ---- group: RH_IN:201:Count
number_slider_3 = Slider(100, range=1..100)

# ----
sph = Sphere(Base=PlaneXY(0, 0, 0), Radius=cell_radius)
addition = Addition(A=number_slider, B=number_slider_2)
series = Series(Start=0, Step=Slider(20, range=0..100), Count=Slider(3, range=0..10))
addition_2 = Addition(A=number_slider, B=number_slider_2)
pt = ConstructPoint(XCoordinate=0, YCoordinate=0, ZCoordinate=series)
popgeo = PopulateGeometry(Geometry=sph, Count=number_slider_3, Seed=1)
dom = ConstructDomain(DomainStart=0, DomainEnd=1)
lng = ListLength(List=pt)
cir = Circle(Plane=pt, Radius=1)
facet = FacetDome(Points=popgeo, Radius=cell_radius)  # -> Pattern, Dome
range = Range(Domain=dom, Steps=expr("x-1", lng))
scale_nu = ScaleNU(Geometry=cir, Plane=pt, ScaleX=addition, ScaleY=addition_2, ScaleZ=1)  # -> Geometry, Transform
boundary = BoundarySurfaces(Edges=facet.Pattern)
rad = Radians(Degrees=range)
rotate = Rotate(Geometry=scale_nu.Geometry, Angle=rad, Plane=PlaneXY(0, 0, 0))  # -> Geometry, Transform
pt_2 = ConstructPoint(XCoordinate="0.5", YCoordinate="0.5", ZCoordinate=0)
number_slider_4 = Slider(20, range=0..100)
loft = Loft(Curves=rotate.Geometry, Options={Adjust=False, Closed=False, LoftEnds=0, LoftSimp=0, LoftType=0, Rebuild=10, Refit=0.01})
evalsrf = EvaluateSurface(Surface=reparameterize(boundary), Point=pt_2)  # -> Point, Normal, UDirection, VDirection, Frame
pt_3 = ConstructPoint(XCoordinate=0, YCoordinate=expr("x*2", cell_radius), ZCoordinate=0)
diamond = DiamondPanels(Surface=loft, UDivisions=number_slider_4, VDivisions=number_slider_4)  # -> DiamondPanels, TriPanels
deplane = DeconstructPlane(Plane=evalsrf.Frame)  # -> Origin, XAxis, YAxis, ZAxis
xy = XYPlane(Origin=pt_3)
amp = Amplitude(Vector=deplane.ZAxis, Amplitude=branch_length)
smesh = SimpleMesh(Brep=flatten([diamond.DiamondPanels, diamond.TriPanels]))
mjoin = MeshJoin(Meshes=smesh)
move = Move(Geometry=facet.Pattern, Motion=amp)  # -> Geometry, Transform
wbjoin = WeaverbirdsJoinMeshesAndWeld(Mesh=mjoin, Weld=True)
explode = Explode(Curve=facet.Pattern, Recursive=True)  # -> graft(Segments), Vertices
explode_2 = Explode(Curve=move.Geometry, Recursive=True)  # -> graft(Segments), Vertices

# ---- group: Generate caps
cp = ControlPoints(Curve=move.Geometry)  # -> Points, Weights, Knots
shift = ShiftList(List=cp.Points, Shift=1, Wrap=invert(True))
del = DelaunayMesh(Points=shift, Plane=PlaneXY(0, 0, 0))
quad = Quadrangulate(Mesh=del, Angle=Slider(1, range=0..1), Ratio=Slider(0, range=0..1))  # -> flatten(Mesh), Count

# ----
weld = WeldMesh(Mesh=wbjoin, Angle=3.141592654)
end = EndPoints(Curve=explode.Segments)  # -> Start, End
end_2 = EndPoints(Curve=explode_2.Segments)  # -> Start, End
alignvert = AlignVertices(Mesh=weld, Tolerance=0.1)  # -> Result, Count
merge = Merge(Data1=end.Start, Data2=end_2.Start, Data3=end_2.End, Data4=end.End)
conmesh = ConstructMesh(Vertices=merge, Faces={A=0, B=1, C=2, D=3})
msphere = MeshSphere(Base=xy, Radius=10, UCount=10, VCount=20)
mjoin_2 = MeshJoin(Meshes=flatten(conmesh))
alignvert_2 = AlignVertices(Mesh=mjoin_2, Tolerance=0.1)  # -> Result, Count
mesh = Mesh(quad.Mesh)
weld_2 = WeldMesh(Mesh=alignvert_2.Result, Angle=3.141592654)
mjoin_3 = MeshJoin(Meshes=flatten([weld_2, mesh, msphere]))
wbcatmullclark = WeaverbirdsCatmullClarkSubdivision(MeshCurves=mjoin_3, Level=1, SmoothNakedEdges=1)
alignvert_3 = AlignVertices(Mesh=wbcatmullclark, Tolerance=0.1)  # -> Result, Count
weld_3 = WeldMesh(Mesh=alignvert_3.Result, Angle=3.141592654)

# ---- group: Mesh to SubD -> SubD to Mesh
c_script = CSharpScript(m=weld_3)  # -> out, A; inputs m: Mesh
# ---------- c_script: C# ----------
    A = Mesh.CreateFromSubD(SubD.CreateFromMesh(m), 2);
# ---------- end c_script ----------

# ----
mjoin_4 = MeshJoin(Meshes=alignvert.Result)
flipm = FlipMesh(Mesh=c_script.A, VertexNormals=True, FaceNormals=True, FaceOrientation=True)

# ---- group: RH_OUT:115:Mesh
mesh_2 = Mesh(flipm)

# ----
mesh_3 = Mesh(mjoin_4)
preview = CustomPreview(Geometry=mesh_2, Material=ColourSwatch(SwatchColor=RGB(255, 255, 255)))
