# Grasshopper definition BranchNodeRnd11.gh (Grasshopper 1.0.7)
# plug-ins: LunchBox, MeshEdit Components, Kangaroo2 Components

# ---- group: RH_IN:201:Length
branch_length = Slider(10, range=0..10)

# ---- group: RH_IN:201:Radius
cell_radius = Slider(10, range=0..10)

# ---- group: RH_IN:201:Count
number_slider = Slider(100, range=1..100)

# ----
number_slider_2 = Slider(4, range=0..10)
series = Series(Start=0, Step=Slider(7, range=0..100), Count=number_slider_2)
pt = ConstructPoint(XCoordinate=0, YCoordinate=series, ZCoordinate=0)
addition = Addition(A=cell_radius, B=Slider(1, range=0..1))
addition_2 = Addition(A=branch_length, B=Slider(1, range=0..1))
dom = ConstructDomain(DomainStart=0, DomainEnd=number_slider)
sph = Sphere(Base=PlaneXY(0, 0, 0), Radius=cell_radius)
xz = XZPlane(Origin=pt)
cir = Circle(Plane=xz, Radius=1)
range = Range(Domain=dom, Steps=expr("x-1", number_slider_2))
scale_nu = ScaleNU(Geometry=cir, Plane=PlaneXY(0, 0, 0), ScaleX=addition, ScaleY=1, ScaleZ=addition_2)  # -> Geometry, Transform
popgeo = PopulateGeometry(Geometry=sph, Count=number_slider, Seed=1)
rad = Radians(Degrees=range)
facet = FacetDome(Points=popgeo, Radius=cell_radius)  # -> Pattern, Dome
rotate = Rotate(Geometry=scale_nu.Geometry, Angle=rad, Plane=xz)  # -> Geometry, Transform
number_slider_3 = Slider(20, range=0..100)
boundary = BoundarySurfaces(Edges=facet.Pattern)
loft = Loft(Curves=rotate.Geometry, Options={Adjust=False, Closed=False, LoftEnds=0, LoftSimp=0, LoftType=0, Rebuild=10, Refit=0.01})
md_slider = MDSlider(SliderMode=0, slider_value=Point(0.5, 0.5, 0.5), x_domain=Domain(0, 1), y_domain=Domain(0, 1), z_domain=Domain(0, 1))
pt_2 = ConstructPoint(XCoordinate="0.5", YCoordinate="0.5", ZCoordinate=0)
diamond = DiamondPanels(Surface=loft, UDivisions=number_slider_3, VDivisions=number_slider_3)  # -> DiamondPanels, TriPanels
evalsrf = EvaluateSurface(Surface=reparameterize(boundary), Point=pt_2)  # -> Point, Normal, UDirection, VDirection, Frame
evalsrf_2 = EvaluateSurface(Surface=reparameterize(diamond.DiamondPanels), Point=md_slider)  # -> Point, Normal, UDirection, VDirection, Frame
wires = BrepWireframe(Brep=diamond.DiamondPanels, Density=-1)
amp = Amplitude(Vector=evalsrf_2.Normal, Amplitude=expr("x*-1", Slider(3, range=0..10)))
deplane = DeconstructPlane(Plane=evalsrf.Frame)  # -> Origin, XAxis, YAxis, ZAxis
join = JoinCurves(Curves=wires, Preserve=False)
move = Move(Geometry=evalsrf_2.Point, Motion=amp)  # -> Geometry, Transform
extr = ExtrudePoint(Base=graft(join), Point=graft(move.Geometry))
amp_2 = Amplitude(Vector=deplane.ZAxis, Amplitude=branch_length)
smesh = SimpleMesh(Brep=flatten([diamond.TriPanels, extr]))
move_2 = Move(Geometry=facet.Pattern, Motion=amp_2)  # -> Geometry, Transform
mjoin = MeshJoin(Meshes=smesh)
explode = Explode(Curve=facet.Pattern, Recursive=True)  # -> graft(Segments), Vertices
explode_2 = Explode(Curve=move_2.Geometry, Recursive=True)  # -> graft(Segments), Vertices
weldvertices = MeshWeldVertices(Mesh=mjoin, Tolerance=0.01)  # -> RuntimeMessage, Mesh

# ---- group: Generate caps
cp = ControlPoints(Curve=move_2.Geometry)  # -> Points, Weights, Knots
shift = ShiftList(List=cp.Points, Shift=1, Wrap=invert(True))
del = DelaunayMesh(Points=shift, Plane=PlaneXY(0, 0, 0))
quad = Quadrangulate(Mesh=del, Angle=Slider(1, range=0..1), Ratio=Slider(0, range=0..1))  # -> flatten(Mesh), Count

# ----
end = EndPoints(Curve=explode.Segments)  # -> Start, End
end_2 = EndPoints(Curve=explode_2.Segments)  # -> Start, End
md_slider_2 = MDSlider(SliderMode=0, slider_value=Point(0.5, 0.5, 0.5), x_domain=Domain(0, 1), y_domain=Domain(0, 1), z_domain=Domain(0, 1))
medges = MeshEdges(Mesh=weldvertices.Mesh)  # -> NakedEdges, InteriorEdges, NonManifoldEdges
merge = Merge(Data1=end.Start, Data2=end_2.Start, Data3=end_2.End, Data4=end.End)
crv = Curve(medges.NakedEdges)
join_2 = JoinCurves(Curves=crv, Preserve=False)
conmesh = ConstructMesh(Vertices=merge, Faces={A=0, B=1, C=2, D=3})
evalsrf_3 = EvaluateSurface(Surface=reparameterize(join_2), Point=md_slider_2)  # -> Point, Normal, UDirection, VDirection, Frame
explode_3 = Explode(Curve=join_2, Recursive=True)  # -> Segments, Vertices
mjoin_2 = MeshJoin(Meshes=flatten(conmesh))
duppt = RemoveDuplicatePts(Points=explode_3.Vertices, Tolerance=0.01)
del_2 = DelaunayMesh(Points=duppt, Plane=graft(evalsrf_3.Frame))
mjoin_3 = MeshJoin(Meshes=flatten([weldvertices.Mesh, del_2]))
alignvert = AlignVertices(Mesh=mjoin_2, Tolerance=0.1)  # -> Result, Count
weldvertices_2 = MeshWeldVertices(Mesh=mjoin_3, Tolerance=0.01)  # -> RuntimeMessage, Mesh
mesh = Mesh(quad.Mesh)
weld = WeldMesh(Mesh=alignvert.Result, Angle=3.141592654)
weld_2 = WeldMesh(Mesh=weldvertices.Mesh, Angle=3.141592654)
mjoin_4 = MeshJoin(Meshes=flatten([weld, mesh]))
panel = Panel(del_2)
alignvert_2 = AlignVertices(Mesh=weldvertices_2.Mesh, Tolerance=0.1)  # -> Result, Count
weld_3 = WeldMesh(Mesh=alignvert_2.Result, Angle=3.141592654)

# ---- group: Mesh to SubD -> SubD to Mesh
c_script = CSharpScript(m=weld_3)  # -> out, A; inputs m: Mesh
# ---------- c_script: C# ----------
    A = Mesh.CreateFromSubD(SubD.CreateFromMesh(m), 2);
# ---------- end c_script ----------

# ----
flipm = FlipMesh(Mesh=c_script.A, VertexNormals=True, FaceNormals=True, FaceOrientation=True)

# ---- group: RH_OUT:115:Mesh
mesh_2 = Mesh(c_script.A)

# ----
preview = CustomPreview(Geometry=mesh_2, Material=ColourSwatch(SwatchColor=RGB(255, 255, 255)))
